test file "BMS_HIL_Test"

suite "Test Suite"

  case "Real-time Test" [real-time]
    model SystemModel, harness BCE_HIL_Harness, start time 0, stop time 20
    baseline "BCE_HarnessOutput.mat"
      Output Conversion Subsystem:1
      Cell_Voltages

suite "Requirement_Test"

  case "Real-time_Req_1" [real-time]
    model SystemModel, stop time 10
    post-load callback:
      set_param('SystemModel/Battery/Bypass/Bypass Values/12-Cell/Cell1_Voltage_Bypass_Value','Value','2');
      set_param('SystemModel/Battery/Bypass/Bypass Values/12-Cell/Cell1_Voltage_Bypass','Value','1');

      set_param('SystemModel/Battery/Bypass/Bypass Values/12-Cell/Cell2_Voltage_Bypass_Value','Value','2');
      set_param('SystemModel/Battery/Bypass/Bypass Values/12-Cell/Cell2_Voltage_Bypass','Value','1');

      set_param('SystemModel/Battery/Bypass/Bypass Values/12-Cell/Cell3_Voltage_Bypass_Value','Value','2');
      set_param('SystemModel/Battery/Bypass/Bypass Values/12-Cell/Cell3_Voltage_Bypass','Value','1');

      set_param('SystemModel/Battery/Bypass/Bypass Values/12-Cell/Cell4_Voltage_Bypass_Value','Value','2');
      set_param('SystemModel/Battery/Bypass/Bypass Values/12-Cell/Cell4_Voltage_Bypass','Value','1');

      set_param('SystemModel/Battery/Bypass/Bypass Values/12-Cell/Cell5_Voltage_Bypass_Value','Value','2');
      set_param('SystemModel/Battery/Bypass/Bypass Values/12-Cell/Cell5_Voltage_Bypass','Value','1');

      set_param('SystemModel/Battery/Bypass/Bypass Values/12-Cell/Cell6_Voltage_Bypass_Value','Value','2');
      set_param('SystemModel/Battery/Bypass/Bypass Values/12-Cell/Cell6_Voltage_Bypass','Value','1');

      set_param('SystemModel/Battery/Bypass/Bypass Values/12-Cell/Cell7_Voltage_Bypass_Value','Value','2');
      set_param('SystemModel/Battery/Bypass/Bypass Values/12-Cell/Cell7_Voltage_Bypass','Value','1');

      set_param('SystemModel/Battery/Bypass/Bypass Values/12-Cell/Cell8_Voltage_Bypass_Value','Value','2');
      set_param('SystemModel/Battery/Bypass/Bypass Values/12-Cell/Cell8_Voltage_Bypass','Value','1');

      set_param('SystemModel/Battery/Bypass/Bypass Values/12-Cell/Cell9_Voltage_Bypass_Value','Value','2');
      set_param('SystemModel/Battery/Bypass/Bypass Values/12-Cell/Cell9_Voltage_Bypass','Value','1');

      set_param('SystemModel/Battery/Bypass/Bypass Values/12-Cell/Cell10_Voltage_Bypass_Value','Value','2');
      set_param('SystemModel/Battery/Bypass/Bypass Values/12-Cell/Cell10_Voltage_Bypass','Value','1');

      set_param('SystemModel/Battery/Bypass/Bypass Values/12-Cell/Cell11_Voltage_Bypass_Value','Value','2');
      set_param('SystemModel/Battery/Bypass/Bypass Values/12-Cell/Cell11_Voltage_Bypass','Value','1');

      set_param('SystemModel/Battery/Bypass/Bypass Values/12-Cell/Cell12_Voltage_Bypass_Value','Value','2');
      set_param('SystemModel/Battery/Bypass/Bypass Values/12-Cell/Cell12_Voltage_Bypass','Value','1');
    baseline "Req1_Output.mat"
      OverCurrent
      HighTemp
      LowTemp
      OverVolt
      UnderVolt
      ChargeModeReq
      BMS_State
      SOC
      Discharge_Current_Limit
      Charge_Current_Limit
      Charge_Current_Req
      Bal_Cmd
      Cell_Voltages
      Cell_Temperatures
      Pack_Current
      Pack_Voltage
      Cell_Voltages
      Pack_Current_Request
      Pack_Voltage
      <Bal_Cmd>
      <Charge_Current_Req>
      <BMS_State>
      <ChargeModeReq>
      <SOC>
      <HighTemp>
      <LowTemp>
      <OverCurrent>
      <OverVolt>
      <UnderVolt>
      <Pack_Current>
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