test file "BMS_MIL_Test"

suite "Requirement_Tests"

  case "BaseLine_Test_Req_1" [baseline]
    model SystemModel, start time 0, stop time 10
    input "1_input.mat" from Req1_Input.mat, mapped to Discharge_Current_Limit, Charge_Current_Limit, State_Request, Sensor_Values, Fault_Reset_Enable (active)
    baseline "1_output.mat"
      <Cell_Temperatures>
      <Cell_Voltages>
      <Pack_Current>
      <Pack_Voltage>
      Charge_Current_Limit:1
      Data Type Conversion:1
      Discharge_Current_Limit:1
      State_Request:1
    baseline "Req1_Input.mat"
      Discharge_Current_Limit
      Charge_Current_Limit
      State_Request
      Cell_Voltages
      Cell_Temperatures
      Pack_Current
      Pack_Voltage
      Fault_Reset_Enable

  case "BaseLine_Test_Req_2" [baseline]
    model SystemModel, harness MIL_Test_Harness, start time 0, stop time 10
    input "2_input.mat", mapped to Discharge_Current_Limit, Charge_Current_Limit, State_Request, Sensor_Values, Fault_Reset_Enable (active)
    baseline "2_output.mat"
      <Cell_Temperatures>
      <Cell_Voltages>
      <Pack_Current>
      <Pack_Voltage>
      Charge_Current_Limit:1
      Data Type Conversion:1
      Discharge_Current_Limit:1
      State_Request:1

  case "BaseLine_Test_Req_3" [baseline]
    model SystemModel, harness SOC_Estimation_Harness, start time 0, stop time 0.1
    input "3_input.mat", mapped to BMS_State, Sensor_Values (active)
    baseline "3_output.mat"
      Output Conversion Subsystem:1

suite "BaseLine_Test"

  case "BaseLine_Test" [baseline]
    model SystemModel, harness MIL_Test_Harness (for SystemModel/BMS/MIL/Controller/BMS State Machine), start time 0, stop time 10
    input "InputBaselineTest.mat", mapped to Discharge_Current_Limit, Charge_Current_Limit, State_Request, Sensor_Values, Fault_Reset_Enable (active)
    baseline "OutputBaselineTest.mat"
      <Cell_Temperatures>
      <Cell_Voltages>
      <Pack_Current>
      <Pack_Voltage>
      Charge_Current_Limit:1
      Data Type Conversion:1
      Discharge_Current_Limit:1
      State_Request:1