# Requirement set Requirements (R2025b)

## 1 [#1] Min and Max controlled Voltage per cell (2.4V to 4.2V)
Controller requirement: Min and Max controlled Voltage per cell in the battery pack to remain between 2.4V and 4.2V

## 2 [#17] Passive Balancing of cells
Controller requirement: Implement passive balacing for cells in the battery pack

## 3 [#2] Fault management system
Controller requirement: Implement a fault management system
Manage faults in the system:
1) Over Voltage
2) Under Voltage
3) Over Current
4) High temperature
5) Low temperature

### 3.1 [#11] Voltage fault management
Manage over-voltage and under-voltage faults for each cell

### 3.2 [#14] Over-current fault management
Over Current should be managed for each cell

### 3.3 [#15] High and low temperature management
High and low temperature faults should be managed for each cell

## 4 [#4] Controller's update frequnecy
Controller requirement: Controller's sample rate should be 1kHz

## 5 [#7] SOC estimation using EKF/UKF
Controller requirement: Use Kalman filter to estimate SOC of the battery pack

## 6 [#8] Override Voltage and Temperature
Testing requirement: Function to override Voltage and temperature values during run-time for testing extreme conditions