test file "OBCSystem_HIL_Test"
  description: OBC Controller HIL compliance tests. Validates PFC and DAB controller behavior under nominal charging conditions using a real-time HIL simulation on the Speedgoat target machine.

suite "HIL Compliance"

  case "Nominal Charging - HIL" [real-time]
    model OBCSystem, stop time 2, target computer My P3
    post-load callback:
      set_param('OBCSystem/System/SimulationMode', 'Value', '2');
      set_param('OBCSystem/System/Controller/PFC Reference DC Voltage', 'Value', '400');
    custom criteria:
      % HIL Real-Time Test Custom Criteria
      % Runs the application with recording to capture signal data.

      tgLocal = slrealtime;
      tgLocal.connect;
      try; tgLocal.stopRecording; catch; end

      % Load, record, and start
      tgLocal.load('OBCSystem');
      tgLocal.setStopTime(2);
      tgLocal.startRecording;
      tgLocal.start;

      % Wait for completion
      tStart = tic;
      while toc(tStart) < 15 && strcmp(tgLocal.status, 'running')
          pause(0.5);
      end
      tgLocal.stopRecording;

      % Get SDI data
      runCount = Simulink.sdi.getRunCount;
      test.verifyTrue(runCount > 0, ...
          sprintf('SDI has recorded data (runs: %d)', runCount));
      if runCount == 0; return; end

      latestRun = Simulink.sdi.Run.getLatest;
      sigIds = latestRun.getAllSignalIDs;

      Vbatt_ts = []; Ibatt_ts = []; VCbus_ts = [];
      for idx = 1:length(sigIds)
          sig = Simulink.sdi.getSignal(sigIds(idx));
          if strcmp(sig.Name, 'Vbatt')
              Vbatt_ts = sig.Values;
          elseif strcmp(sig.Name, 'Ibatt')
              Ibatt_ts = sig.Values;
          elseif strcmp(sig.Name, '<VCbus>')
              VCbus_ts = sig.Values;
          end
      end

      % Check 1: Vbatt steady-state (350-420 V)
      if ~isempty(Vbatt_ts)
          n = length(Vbatt_ts.Data);
          ssIdx = round(0.75 * n);
          Vbatt_ss = mean(double(Vbatt_ts.Data(ssIdx:end)));
          test.verifyTrue(Vbatt_ss > 350 && Vbatt_ss < 420, ...
              sprintf('Vbatt steady-state = %.1f V (expected 350-420 V)', Vbatt_ss));
      else
          test.verifyTrue(false, 'Vbatt signal not found in SDI');
      end

      % Check 2: Ibatt steady-state (0-80 A, charging)
      if ~isempty(Ibatt_ts)
          n = length(Ibatt_ts.Data);
          ssIdx = round(0.75 * n);
          Ibatt_ss = mean(double(Ibatt_ts.Data(ssIdx:end)));
          test.verifyTrue(Ibatt_ss > 0 && Ibatt_ss < 80, ...
              sprintf('Ibatt steady-state = %.2f A (expected 0-80 A)', Ibatt_ss));
      else
          test.verifyTrue(false, 'Ibatt signal not found in SDI');
      end

      % Check 3: VCbus close to 400V (within +/- 20V)
      if ~isempty(VCbus_ts)
          n = length(VCbus_ts.Data);
          ssIdx = round(0.75 * n);
          VCbus_ss = mean(double(VCbus_ts.Data(ssIdx:end)));
          test.verifyTrue(abs(VCbus_ss - 400) < 20, ...
              sprintf('VCbus steady-state = %.1f V (expected 400 +/- 20 V)', VCbus_ss));
      else
          test.verifyTrue(false, 'VCbus signal not found in SDI');
      end