% Simulink data dictionary PMSM3P2LInverterDd.sldd

gain = 0.1
ts_FPGA_mdl = 1.0e-6
PU_System_N_base = 4107
F28379D_ADC_MaxCount = 4095
IO334_DAC_Vmax = 2.5
Ts_speed = 0.0005
PU_System_I_base = 21.42857
IO334_iDAC_bias = 5
IO334_resolverDAC_gain = 0.1
IO334_resolverDAC_bias = 5
IO334_vDAC_bias = 5
IO334_vDAC_gain = 5
F28379D_PWM_Counter_Period = 5000
Maxon_645604_Rs = 0.293
Maxon_645604_Np = 7
Maxon_645604_Ld = 0.000279
Maxon_645604_Lq = 0.000279
Maxon_645604_lambda_pm = 0.005
Maxon_645604_J = 8.35e-5
Maxon_645604_ViscousF = 5.35e-5
Maxon_645604_StaticF = 0.0065
Maxon_Mile_Nslits = 4096
Foc_Kp_S = 1
Foc_Ki_S = 0.05
Foc_Kp_I = 0.1
Foc_Ki_IxTcpu = 0.0001
Ts_UI = 0.1
Maxon_Mile_Angle_Offset = 0
Tconfigurable = 5.0e-5
Controller = "CAN_Launchpad"
Target = "324_Configurable"
F28379D_ADC_Vmax = 3.3
Ts_CAN_Tx = 0.2
f_FPGA = 200000000
Sig = Simulink.Signal()
Ts_CPU = 5.0e-5
Ts_UI_fast = 0.0005
Sig1 = Simulink.Signal()
IO334_iDAC_gain = 0.2
PWM_frequency = 20000

CAN_MESSAGE_BUS = Simulink.Bus()
  Extended: uint8
  Length: uint8
  Remote: uint8
  Error: uint8
  ID: uint32
  Timestamp: double
  Data: uint8[8]

Ia_offset = -25.00232
Ib_offset = -24.99959