test file "TestCases"

suite "Baseline_CAN_HIL_Tests"

  case "Speed_Step_500rpm_FOC" [real-time]
    model PMSM3P2LInverterCHILsystem, harness PMSM3P2LInverterCHILsystem_Harness1 (for PMSM3P2LInverterCHILsystem/Three-Phase PMSM System/Controller/Controller_HIL_CAN), start time 0, stop time 10
    post-load callback:
      set_param([sltest_bdroot,'/Cmd_Inputs'], ...
          'ActiveScenario','SpeedStep500rpm');% Select Scenario for CAN commands
      set_param([sltest_bdroot,'/Plant_Conditions'], ...
          'ActiveScenario','StandardNoLoad');% Select Scenario for Plant
    baseline "SpeedStep500rpm.mat"
      Motor Speed RPM: abs tol 40, rel tol 0.1, leading tol 0.1, lagging tol 0.1

  case "Speed_Step_500rpm_Sinus_Fault" [real-time]
    model PMSM3P2LInverterCHILsystem, harness PMSM3P2LInverterCHILsystem_Harness1 (for PMSM3P2LInverterCHILsystem/Three-Phase PMSM System/Controller/Controller_HIL_CAN), start time 0, stop time 10
    post-load callback:
      set_param([sltest_bdroot,'/Cmd_Inputs'], ...
          'ActiveScenario','SpeedStep500rpm_Sinus');% Select Scenario for CAN commands
      set_param([sltest_bdroot,'/Plant_Conditions'], ...
          'ActiveScenario','StandardNoLoad_Fault5s');% Select Scenario for Plant
    baseline "SpeedStep500rpmFault.mat"
      Ia: abs tol 10, rel tol 0.1, leading tol 0.1, lagging tol 0.1
      Ib: abs tol 10, rel tol 0.1, leading tol 0.1, lagging tol 0.1
      Ic: abs tol 10, rel tol 0.1, leading tol 0.1, lagging tol 0.1
      Motor Speed RPM: abs tol 40, rel tol 0.1, leading tol 0.1, lagging tol 0.1

suite "Real_Time_MIL"

  case "RT_MIL_500rpm_SINUS" [real-time]
    model PMSM3P2LInverterCHILsystem, stop time 10
    post-load callback:
      % Configure testbench for desktop MIL simulation using average model
      set_param([bdroot '/Three-Phase PMSM System/SimulationVariant'], 'Value','2')

      % Configure Test Values
      set_param([bdroot '/Three-Phase PMSM System/Speed_Cmd_rpm'], 'Value','500')
      set_param([bdroot '/Three-Phase PMSM System/Closed_Loop_FOC'], 'Value','0')
      set_param([bdroot '/Three-Phase PMSM System/EnablePWM'], 'Value','1')
      set_param([bdroot '/Three-Phase PMSM System/Controller Parameters/Default Values'], 'Value','1')
    baseline "RTMIL500rpm.mat" (1 of 2 signals compared)
      Motor Speed RPM: abs tol 30, rel tol 0.1, leading tol 0.1, lagging tol 0.1

  case "RT_MIL_500rpm_FOC" [real-time]
    model PMSM3P2LInverterCHILsystem, stop time 10
    post-load callback:
      % Configure testbench for desktop MIL simulation using average model
      set_param([bdroot '/Three-Phase PMSM System/SimulationVariant'], 'Value','2')

      % Configure Test Values
      set_param([bdroot '/Three-Phase PMSM System/Speed_Cmd_rpm'], 'Value','500')
      set_param([bdroot '/Three-Phase PMSM System/Closed_Loop_FOC'], 'Value','1')
      set_param([bdroot '/Three-Phase PMSM System/EnablePWM'], 'Value','1')
      set_param([bdroot '/Three-Phase PMSM System/Controller Parameters/Default Values'], 'Value','1')
    baseline "RTMIL500rpmFOC.mat": rel tol 0.1, leading tol 0.1, lagging tol 0.1
      Speed_fbk: abs tol 10, rel tol 0.1, leading tol 0.1, lagging tol 0.1
      Ia: abs tol 0.1, rel tol 0.1, leading tol 0.1, lagging tol 0.1
      Ib: abs tol 0.1, rel tol 0.1, leading tol 0.1, lagging tol 0.1
      Ic: abs tol 0.1, rel tol 0.1, leading tol 0.1, lagging tol 0.1
      Motor Speed RPM: abs tol 30, rel tol 0.1, leading tol 0.1, lagging tol 0.1

suite "MIL"

  case "MIL_500rpm_SINUS" [real-time]
    model PMSM3P2LInverterCHILsystem, start time 0, stop time 10
    post-load callback:
      % Configure testbench for desktop MIL simulation using average model
      set_param([bdroot '/Three-Phase PMSM System/SimulationVariant'], 'Value','1')

      set_param([bdroot '/Three-Phase PMSM System/Speed_Cmd_rpm'], 'Value','500')
      set_param([bdroot '/Three-Phase PMSM System/Closed_Loop_FOC'], 'Value','0')
      set_param([bdroot '/Three-Phase PMSM System/EnablePWM'], 'Value','1')
      set_param([bdroot '/Three-Phase PMSM System/Controller Parameters/Default Values'], 'Value','1')
    baseline "MIL500rpm.mat"
      Ia: abs tol 0.1, rel tol 0.1, leading tol 0.1, lagging tol 0.1
      Ib: abs tol 0.1, rel tol 0.1, leading tol 0.1, lagging tol 0.1
      Ic: abs tol 0.1, rel tol 0.1, leading tol 0.1, lagging tol 0.1
      Motor Speed RPM: abs tol 10, rel tol 0.1, leading tol 0.1, lagging tol 0.1