test file "OBCSystem_MIL_Test"
  description: OBC Controller MIL compliance tests. Validates PFC and DAB controller behavior under nominal charging conditions using a full closed-loop MIL simulation (Mode 1).

suite "MIL Compliance"

  case "Nominal Charging - MIL" [simulation]
    model OBCSystem, mode Normal, stop time 0.002
    post-load callback:
      set_param('OBCSystem/System/SimulationMode', 'Value', '1');
      set_param('OBCSystem/System/Controller/PFC Reference DC Voltage', 'Value', '400');
    custom criteria:
      % OBC MIL Compliance - Custom Criteria
      % Extracts logged signals and verifies controller limits
      % Note: 2 ms simulation captures initial transient behavior.

      logsout = test.sltest_simout.logsout;

      % Build signal lookup
      sigMap = containers.Map();
      for kk = 1:logsout.numElements
          el = logsout.getElement(kk);
          sigMap(el.Name) = el;
      end

      % Extract signal data
      % Bus Selector signals have angle brackets: <VCbus>, <iL_PFC>
      % Direct logged signals do not: Vbatt, Ibatt, phi [deg]
      names = {'<VCbus>', '<iL_PFC>', 'Vbatt', 'Ibatt', 'phi [deg]'};
      fields = {'VCbus', 'iL_PFC', 'Vbatt', 'Ibatt', 'phi_deg'};
      data = struct();
      for kk = 1:length(names)
          nm = names{kk};
          fld = fields{kk};
          if sigMap.isKey(nm)
              data.(fld) = double(squeeze(sigMap(nm).Values.Data));
          else
              data.(fld) = [];
              test.verifyTrue(false, sprintf('Signal %%s not found in logsout', nm));
          end
      end

      % Steady-state region = last 25% of simulation
      ssStart = 0.75;

      % ---- Check 1: DC Bus Voltage in [350, 450] V (steady state) ----
      vdc = data.VCbus;
      if ~isempty(vdc)
          ssIdx = round(ssStart*length(vdc)):length(vdc);
          vdc_ss = vdc(ssIdx);
          test.verifyTrue(all(vdc_ss >= 350 & vdc_ss <= 450), ...
              sprintf('DC Voltage out of [350,450] V: range [%.1f, %.1f]', min(vdc_ss), max(vdc_ss)));

          % ---- Check 2: No overvoltage (entire sim < 500 V) ----
          test.verifyTrue(all(vdc <= 500), ...
              sprintf('Overvoltage detected: peak %.1f V', max(vdc)));
      end

      % ---- Check 3: PFC inductor current peak < 60 A ----
      il = data.iL_PFC;
      if ~isempty(il)
          test.verifyTrue(all(abs(il) < 60), ...
              sprintf('iL_PFC peak too high: %.1f A', max(abs(il))));
      end

      % ---- Check 4: Battery voltage in [350, 420] V (steady state) ----
      vb = data.Vbatt;
      if ~isempty(vb)
          ssIdxVb = round(ssStart*length(vb)):length(vb);
          vb_ss = vb(ssIdxVb);
          test.verifyTrue(all(vb_ss >= 350 & vb_ss <= 420), ...
              sprintf('Vbatt out of [350,420] V: range [%.1f, %.1f]', min(vb_ss), max(vb_ss)));
      end

      % ---- Check 5: Battery current bounded in steady state (< 80 A) ----
      % Note: 2 ms sim has startup transient; check last 25% only.
      ib = data.Ibatt;
      if ~isempty(ib)
          ssIdxIb = round(ssStart*length(ib)):length(ib);
          ib_ss = ib(ssIdxIb);
          test.verifyTrue(all(abs(ib_ss) < 80), ...
              sprintf('Ibatt steady-state peak too high: %.1f A', max(abs(ib_ss))));
      end

      % ---- Check 6: DAB phase shift in [-90, 90] deg ----
      phi = data.phi_deg;
      if ~isempty(phi)
          test.verifyTrue(all(phi >= -90 & phi <= 90), ...
              sprintf('Phase shift out of [-90,90]: range [%.1f, %.1f]', min(phi), max(phi)));
      end