% Simulink data dictionary VTOLDynamicsData.sldd

ControlSampleTime = 0.005
FWTrimSpeed = 166.667
UAVSampleTime = 0.005
Vcruise = 16
Vt = 14

control = struct(
  turningRadius=60,
  L1=60,
  transitionRadius=60,
  minThrottle=0,
  maxThrottle=1,
  slewRateThrottle=1,
  slewRateServos=5,
  maxPitch=0.1745329,
  minPitch=-0.1745329,
  maxRoll=0.6981317,
  minRoll=-0.6981317,
  maxRollRate=1.22173,
  minRollRate=-1.22173,
  maxPitchRate=1.22173,
  minPitchRate=-1.22173,
  maxClimbRate=3,
  maxDescendRate=-3,
  stallSpeed=9.5,
  cruiseSpeed=20,
  takeoffSpeed=12.35,
  takeoffNavAlt=5,
  climboutAltMin=10,
  climboutAlt=13,
  landingApproachSpeed=12.35,
  flarePitch=0.03490659,
  flareAlt=2,
  landStopVel=1,
  finalLoiterSpeed=15)

tilt_trim = 0

uavParam_Works = struct(
  aero=struct(
    rho=1.225,
    CL0=0.81857,
    CLa=4.09127,
    CLa_dot=0,
    CLq=7.31097,
    CLDe=0.50787,
    CLDa=-0.85291,
    CDmin=0.06047,
    K=0.1328,
    CL_CDmin=0.4806,
    A1=0,
    CdDe=0.016043,
    CdDa=0.092132,
    CdDr=0.0097403,
    Cm0=0.00763,
    Cma=-1.76966,
    Cmq=-19.22663,
    CmDe=-1.83747,
    CYb=-0.00157,
    CYp=-0.00157,
    CYr=0.18368,
    CYDr=0.128915,
    Clb=-0.00161,
    Clp=-0.47584,
    Clr=0.27153,
    ClDa=0.286593,
    ClDr=0.013407,
    Cnb=0.0918,
    Cnp=-0.13267,
    Cnr=-0.08829,
    CnDa=0.0049274,
    CnDr=-0.067036,
    dragCoeffMov=0.027,
    g=9.806),
  geom=struct(
    b=2,
    AR=7.2727,
    c=0.275,
    e=0.986,
    RotorArm1=[0.375 0.375 0],
    RotorArm2=[0.375 -0.375 0],
    RotorArm3=[-0.375 -0.375 0],
    RotorArm4=[-0.375 0.375 0],
    Ixx=0.267,
    Iyy=0.267,
    Izz=0.375,
    mass=6.023,
    PropDiameter=0.3052),
  motor=struct(RPMMAX=10000, tilt_trim=0))

w_trim = 110.3898
windVel = [0 0 0]

doubleUavPathManager = Simulink.Bus()
  mode: uint8
  position: double[3 1]
  params: double[4 1]

innerLoopCmdsBus = Simulink.Bus()
  LAP: double[3]
  HeadingCmd: double
  YawCmd: double

FWControl = struct(transitionRadius=10)

GuidanceStates = Simulink.Bus()
  Euler: double[3]
  pqr: double[3]
  Ve: double[3]
  Xe: double[3]
  course: double
  Tilt: double

MaxTilt = 1.047198
TiltScheduleRate = 0.2617994
CriticalTiltAngle = 1.047198
WindDownRate = 20

env = struct(
  ISA_lapse=0.0065,
  ISA_hmax=2000,
  ISA_R=287.0531,
  ISA_g=9.80665,
  ISA_rho0=1.225,
  ISA_P0=101325,
  ISA_T0=288.15,
  windBase=12,
  windDirTurb=180,
  windDirHor=90,
  windOn=0)

Battery = struct(
  SOC_LUT=[0; 0.2336168; 0.3294147; 0.4252126; 0.5210105; 0.6168084; 0.7126063; 0.8084042; 0.9042021; 1],
  Temperature_LUT=[278.15 293.15 323.15],
  Capacity_LUT=[31 31 31],
  Em_LUT=[3.495876 3.513261 3.515929
   3.558586 3.571954 3.572374
   3.607242 3.620683 3.627655
   3.647712 3.6576 3.666113
   3.693146 3.69761 3.706816
   3.755492 3.757733 3.766967
   3.841654 3.850835 3.866459
   3.951051 3.957725 3.966174
   4.063666 4.067089 4.072363
   4.190652 4.190612 4.191672],
  R0_LUT=[0.009999981 0.009693751 0.007081459
   0.009998564 0.009112391 0.007873589
   0.009987303 0.008946325 0.008371746
   0.009962629 0.008794302 0.00835611
   0.009872754 0.008370281 0.008207898
   0.009995431 0.007966578 0.007837292
   0.009901997 0.008293178 0.008431849
   0.009947531 0.008462239 0.008577474
   0.009888643 0.008600463 0.007838093
   0.009935466 0.008694306 0.007610306],
  R1_LUT=[0.004999478 0.001764148 0.003164036
   0.0049952 0.0018232 0.002227583
   0.004979423 0.002156026 0.001985157
   0.004981172 0.001900603 0.001830198
   0.004509405 0.001789879 0.001838038
   0.00398128 0.001918548 0.002074314
   0.003766915 0.001880084 0.001986724
   0.004191636 0.002144337 0.001619022
   0.00442604 0.001552468 0.002110344
   0.004314838 0.001549708 0.002187277],
  C1_LUT=[1983.385 78841.49 1101.576
   4685.295 46429.68 4135.528
   9956.775 63356.41 12730.6
   11168.87 44437.72 12079.47
   4241.754 25121.86 9873.972
   4860.185 15430.16 2313.843
   8563.329 19567.71 8773.596
   11272.46 21732.15 11126.47
   3899.653 15798.99 2546.168
   2937.385 42171.32 1720.829],
  cell_mass=0.84,
  cell_rho_Cp=2040000,
  cell_Cp_heat=964.92,
  T_init=288.15,
  Qe_init=7.75,
  R_bleed=20,
  h_conv=5,
  cell_area=0.1019,
  TempInit=288.15,
  SOCInit=[0.75 0.75 0.75 0.75 0.78 0.72 0.75 0.75 0.75 0.75 0.78 0.72])

CellType = 1
NumModules = 1
OverCellVoltageLimit = single(4.4)
UnderCellVoltageLimit = single(2.5)
R_bleed = 20
TempInit = 288.15
cell_area = 0.101908
h_conv = 5
CV_Gain = single(0.2)
I_cc = single(30)
MaxCellVoltThrsld = single(4.2)
currentFactor = single(10)
noCurrent = single(0)
voltThreshold = single(4.1)
flgEnBalancing = true

Charging_State = enum(DefaultValue="Init", StorageType="uint8")
  Init = 0
  CC = 1
  CV = 2

BalNotActWait = int16(10)
BalOnWait = int16(11)
BalOffWait = int16(0)

BceUnitIn = Simulink.Bus()
  Cell_1: Bus: CellMeas
  Cell_2: Bus: CellMeas
  Cell_3: Bus: CellMeas
  Cell_4: Bus: CellMeas
  Cell_5: Bus: CellMeas
  Cell_6: Bus: CellMeas
  Cell_7: Bus: CellMeas
  Cell_8: Bus: CellMeas
  Cell_9: Bus: CellMeas
  Cell_10: Bus: CellMeas
  Cell_11: Bus: CellMeas
  Cell_12: Bus: CellMeas

BceUnitOut = Simulink.Bus()
  Cell_1: Bus: CellSim
  Cell_2: Bus: CellSim
  Cell_3: Bus: CellSim
  Cell_4: Bus: CellSim
  Cell_5: Bus: CellSim
  Cell_6: Bus: CellSim
  Cell_7: Bus: CellSim
  Cell_8: Bus: CellSim
  Cell_9: Bus: CellSim
  Cell_10: Bus: CellSim
  Cell_11: Bus: CellSim
  Cell_12: Bus: CellSim

CellMeas = Simulink.Bus()
  V: single
  I: single

CellSim = Simulink.Bus()
  V: single
  I: single
  Charge: uint64

outData = struct(
  Cell_1=struct(V=single(0), I=single(0), Charge=fi(0, 0, 64, 0)),
  Cell_2=struct(V=single(0), I=single(0), Charge=fi(0, 0, 64, 0)),
  Cell_3=struct(V=single(0), I=single(0), Charge=fi(0, 0, 64, 0)),
  Cell_4=struct(V=single(0), I=single(0), Charge=fi(0, 0, 64, 0)),
  Cell_5=struct(V=single(0), I=single(0), Charge=fi(0, 0, 64, 0)),
  Cell_6=struct(V=single(0), I=single(0), Charge=fi(0, 0, 64, 0)),
  Cell_7=struct(V=single(0), I=single(0), Charge=fi(0, 0, 64, 0)),
  Cell_8=struct(V=single(0), I=single(0), Charge=fi(0, 0, 64, 0)),
  Cell_9=struct(V=single(0), I=single(0), Charge=fi(0, 0, 64, 0)),
  Cell_10=struct(V=single(0), I=single(0), Charge=fi(0, 0, 64, 0)),
  Cell_11=struct(V=single(0), I=single(0), Charge=fi(0, 0, 64, 0)),
  Cell_12=struct(V=single(0), I=single(0), Charge=fi(0, 0, 64, 0)))

BMS_Controller_State = enum(DefaultValue="BMS_Idle", StorageType="uint8")
  BMS_Idle = 0
  BMS_Driving = 1
  BMS_Charging = 2
  BMS_Fault = 3

Faults = Simulink.Bus()
  OverCurrent: boolean
  HighTemp: boolean
  LowTemp: boolean
  OverVolt: boolean
  UnderVolt: boolean

Controller_Info = Simulink.Bus()
  BMS_Faults: Bus: Faults
  ChargeModeReq: Enum: Charging_State
  BMS_State: Enum: BMS_Controller_State
  SOC: single[3 1]

ts_controller = 0.01

BCE_Get = Simulink.Bus()
  Cell_1: Bus: Cell_Get
  Cell_2: Bus: Cell_Get
  Cell_3: Bus: Cell_Get
  Cell_4: Bus: Cell_Get
  Cell_5: Bus: Cell_Get
  Cell_6: Bus: Cell_Get
  Cell_7: Bus: Cell_Get
  Cell_8: Bus: Cell_Get
  Cell_9: Bus: Cell_Get
  Cell_10: Bus: Cell_Get
  Cell_11: Bus: Cell_Get
  Cell_12: Bus: Cell_Get

BCE_Get_init = struct(
  Cell_1=struct(Status=uint16(0), V=single(0), I=single(0), Charge=fi(0, 0, 64, 0)),
  Cell_2=struct(Status=uint16(0), V=single(0), I=single(0), Charge=fi(0, 0, 64, 0)),
  Cell_3=struct(Status=uint16(0), V=single(0), I=single(0), Charge=fi(0, 0, 64, 0)),
  Cell_4=struct(Status=uint16(0), V=single(0), I=single(0), Charge=fi(0, 0, 64, 0)),
  Cell_5=struct(Status=uint16(0), V=single(0), I=single(0), Charge=fi(0, 0, 64, 0)),
  Cell_6=struct(Status=uint16(0), V=single(0), I=single(0), Charge=fi(0, 0, 64, 0)),
  Cell_7=struct(Status=uint16(0), V=single(0), I=single(0), Charge=fi(0, 0, 64, 0)),
  Cell_8=struct(Status=uint16(0), V=single(0), I=single(0), Charge=fi(0, 0, 64, 0)),
  Cell_9=struct(Status=uint16(0), V=single(0), I=single(0), Charge=fi(0, 0, 64, 0)),
  Cell_10=struct(Status=uint16(0), V=single(0), I=single(0), Charge=fi(0, 0, 64, 0)),
  Cell_11=struct(Status=uint16(0), V=single(0), I=single(0), Charge=fi(0, 0, 64, 0)),
  Cell_12=struct(Status=uint16(0), V=single(0), I=single(0), Charge=fi(0, 0, 64, 0)))

BCE_Set = Simulink.Bus()
  Cell_1: Bus: Cell_Set
  Cell_2: Bus: Cell_Set
  Cell_3: Bus: Cell_Set
  Cell_4: Bus: Cell_Set
  Cell_5: Bus: Cell_Set
  Cell_6: Bus: Cell_Set
  Cell_7: Bus: Cell_Set
  Cell_8: Bus: Cell_Set
  Cell_9: Bus: Cell_Set
  Cell_10: Bus: Cell_Set
  Cell_11: Bus: Cell_Set
  Cell_12: Bus: Cell_Set

BCE_Set_init = struct(
  Cell_1=struct(Enable=false, V=single(0), I=single(0)),
  Cell_2=struct(Enable=false, V=single(0), I=single(0)),
  Cell_3=struct(Enable=false, V=single(0), I=single(0)),
  Cell_4=struct(Enable=false, V=single(0), I=single(0)),
  Cell_5=struct(Enable=false, V=single(0), I=single(0)),
  Cell_6=struct(Enable=false, V=single(0), I=single(0)),
  Cell_7=struct(Enable=false, V=single(0), I=single(0)),
  Cell_8=struct(Enable=false, V=single(0), I=single(0)),
  Cell_9=struct(Enable=false, V=single(0), I=single(0)),
  Cell_10=struct(Enable=false, V=single(0), I=single(0)),
  Cell_11=struct(Enable=false, V=single(0), I=single(0)),
  Cell_12=struct(Enable=false, V=single(0), I=single(0)))

Cell_Get = Simulink.Bus()
  Status: uint16
  V: single
  I: single
  Charge: uint64

Cell_Set = Simulink.Bus()
  Enable: boolean
  V: single
  I: single

inData = struct(
  Cell_1=struct(Enable=single(0), V=single(0), I=single(0)),
  Cell_2=struct(Enable=single(0), V=single(0), I=single(0)),
  Cell_3=struct(Enable=single(0), V=single(0), I=single(0)),
  Cell_4=struct(Enable=single(0), V=single(0), I=single(0)),
  Cell_5=struct(Enable=single(0), V=single(0), I=single(0)),
  Cell_6=struct(Enable=single(0), V=single(0), I=single(0)),
  Cell_7=struct(Enable=single(0), V=single(0), I=single(0)),
  Cell_8=struct(Enable=single(0), V=single(0), I=single(0)),
  Cell_9=struct(Enable=single(0), V=single(0), I=single(0)),
  Cell_10=struct(Enable=single(0), V=single(0), I=single(0)),
  Cell_11=struct(Enable=single(0), V=single(0), I=single(0)),
  Cell_12=struct(Enable=single(0), V=single(0), I=single(0)))

CAN_MESSAGE_BUS = Simulink.Bus()
  Extended: uint8
  Length: uint8
  Remote: uint8
  Error: uint8
  ID: uint32
  Timestamp: double
  Data: uint8[8]

gain = 0.1
ts_FPGA_mdl = 1.0e-6
F28379D_ADC_MaxCount = 4095
IO334_DAC_Vmax = 2.5
Ts_speed = 0.0005
IO334_iDAC_bias = 5
IO334_iDAC_gain = 0.1
IO334_resolverDAC_gain = 0.1
IO334_resolverDAC_bias = 5
IO334_vDAC_bias = 5
IO334_vDAC_gain = 5
F28379D_PWM_Counter_Period = 5000
Maxon_645604_Rs = 0.293
Maxon_645604_Ld = 0.000279
Maxon_645604_Lq = 0.000279
Maxon_645604_lambda_pm = 0.005
Maxon_645604_J = 8.35e-5
Maxon_645604_ViscousF = 5.35e-5
Maxon_645604_StaticF = 0.0065
Maxon_Mile_Nslits = 4096
Foc_Kp_S = 1
Foc_Ki_S = 0.05
Foc_Kp_I = 0.1
Foc_Ki_IxTcpu = 0.0001
Ts_UI = 0.1
Maxon_Mile_Angle_Offset = 0
Controller = "CAN_Launchpad"
Target = "324_Configurable"
F28379D_ADC_Vmax = 3.3
Ts_CAN_Tx = 0.2
f_FPGA = 200000000
Sig = Simulink.Signal()
Ts_UI_fast = 0.0005
Ia_offset = 0.2601001
Ib_offset = -0.5047023
PWM_frequency = 20000
SOCInit = 0.95
Ns_Module = 100
PU_System_I_base = 21.42857
Maxon_645604_Np = 7
PU_System_N_base = 4107

Sensor_Values = Simulink.Bus()
  Cell_Voltages: single[Ns_Module]
  Cell_Temperatures: single[Ns_Module]
  Pack_Current: single
  Pack_Voltage: single
  Pack_Voltage1: single
  Pack_Voltage2: single

SRE = enum(DefaultValue="Standby", StorageType="uint8")
  Standby = 0
  Flying = 1
  Charging = 2

ts_system = 0.01
Tconfigurable = 0.0001

Controller_Output = Simulink.Bus()
  Discharge_Current_Limit: single
  Charge_Current_Limit: single
  Charge_Current_Req: single
  Bal_Cmd: boolean[100]

simTime = 200
VTOLConfiguration = Simulink.ConfigSet(StartTime="0", StopTime="simTime", Solver="FixedStepAuto", ProdHWDeviceType="Intel->x86-64 (Linux 64)", SystemTargetFile="speedgoat.tlc", TargetLang="C++")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
Ts_CPU = 5.0e-5