test file "eVTOL_Motor_Test"

suite "Baseline_CAN_HIL_Tests"

  case "Speed_Step_500rpm_FOC" [real-time]
    model eVTOL_System, harness Controller_HIL_CAN_Harness (for eVTOL_System/Motor Drive/Controller/Controller_HIL_CAN), start time 0, stop time 10
    post-load callback:
      set_param([sltest_bdroot,'/Cmd_Inputs'], ...
          'ActiveScenario','SpeedStep500rpm');% Select Scenario for CAN commands
      set_param([sltest_bdroot,'/Plant_Conditions'], ...
          'ActiveScenario','StandardNoLoad');% Select Scenario for Plant
    baseline "SpeedStep500rpm.mat" (1 of 2 signals compared)
      Motor Speed RPM: abs tol 40, rel tol 0.1, leading tol 0.1, lagging tol 0.1

  case "Speed_Step_500rpm_Sinus_Fault" [real-time]
    model eVTOL_System, harness Controller_HIL_CAN_Harness (for eVTOL_System/Motor Drive/Controller/Controller_HIL_CAN), start time 0, stop time 10
    post-load callback:
      set_param([sltest_bdroot,'/Cmd_Inputs'], ...
          'ActiveScenario','SpeedStep500rpm_Sinus');% Select Scenario for CAN commands
      set_param([sltest_bdroot,'/Plant_Conditions'], ...
          'ActiveScenario','StandardNoLoad_Fault5s');% Select Scenario for Plant
    baseline "SpeedStep500rpmFault.mat": rel tol 0.1, leading tol 0.1, lagging tol 0.1
      Ia: abs tol 10, rel tol 0.1, leading tol 0.1, lagging tol 0.1
      Ib: abs tol 10, rel tol 0.1, leading tol 0.1, lagging tol 0.1
      Ic: abs tol 10, rel tol 0.1, leading tol 0.1, lagging tol 0.1
      Motor Speed RPM: abs tol 40, rel tol 0.1, leading tol 0.1, lagging tol 0.1