# Requirement set eVTOL_Requirements (R2024a)

## 1 [#1] Motor power 200kW+
Each motor should be rated above 150kW

## 2 [#2] Passive cell balancing
All 100 cells should be capable of balancing cells passively

## 3 [#3] Battery Pack should be of minimum 400V
400V+ battery pack

## 4 [#4] Battery voltage drop
Battery voltage drop should not be more than 80% of battery Voltage.

## 5 [#6] Fault Management
Faults:
Over Current
High Temperature
Low Temperature
Over Voltage
Under Voltage

## 6 [#7] Calculate SOC using EKF/UKF
Use Kalman filter to estimate SOC

## 7 [#8] Flight controller
Flight controller should activate motor control algorithm