% Simulink data dictionary inverter_hil.sldd

hil_model_release = "R2024b"
hil_base_sample_s = Simulink.Parameter(0.001, StorageClass="SimulinkGlobal", Min=0.001, Max=0.001)
hil_status_sample_s = Simulink.Parameter(0.005, StorageClass="SimulinkGlobal", Min=0.005, Max=0.005)
hil_cmd_pedals_throttle = Simulink.Parameter(0, StorageClass="SimulinkGlobal", Min=0, Max=1)
hil_cmd_pedals_brake = Simulink.Parameter(0, StorageClass="SimulinkGlobal", Min=0, Max=1)
hil_cmd_steering_angle_deg = Simulink.Parameter(0, StorageClass="SimulinkGlobal", Min=-780, Max=780)
hil_cmd_steering_dropout = Simulink.Parameter(false, StorageClass="SimulinkGlobal", DataType="boolean", Min=0, Max=1)
hil_cmd_steering_stale = Simulink.Parameter(false, StorageClass="SimulinkGlobal", DataType="boolean", Min=0, Max=1)
hil_cmd_steering_malformed = Simulink.Parameter(false, StorageClass="SimulinkGlobal", DataType="boolean", Min=0, Max=1)
hil_cmd_steering_invalid_status = Simulink.Parameter(false, StorageClass="SimulinkGlobal", DataType="boolean", Min=0, Max=1)
hil_cmd_steering_angle_sentinel = Simulink.Parameter(false, StorageClass="SimulinkGlobal", DataType="boolean", Min=0, Max=1)
hil_cmd_steering_speed_sentinel = Simulink.Parameter(false, StorageClass="SimulinkGlobal", DataType="boolean", Min=0, Max=1)
hil_cmd_steering_calibration_sequence = Simulink.Parameter(uint32(0), StorageClass="SimulinkGlobal", Min=0, Max=4294967295)
hil_cmd_imu_dropout = Simulink.Parameter(false, StorageClass="SimulinkGlobal", DataType="boolean", Min=0, Max=1)
hil_cmd_imu_stale = Simulink.Parameter(false, StorageClass="SimulinkGlobal", DataType="boolean", Min=0, Max=1)
hil_cmd_imu_malformed = Simulink.Parameter(false, StorageClass="SimulinkGlobal", DataType="boolean", Min=0, Max=1)
hil_cmd_xcp_pedals_throttle = Simulink.Parameter(0, StorageClass="SimulinkGlobal", Min=0, Max=100)
hil_cmd_xcp_pedals_brake = Simulink.Parameter(0, StorageClass="SimulinkGlobal", Min=0, Max=100)
hil_cmd_xcp_pedals_active = Simulink.Parameter(false, StorageClass="SimulinkGlobal", DataType="boolean", Min=0, Max=1)
hil_obs_virtual_vcu_pedal_payload = Simulink.Signal(StorageClass="ExportedGlobal")  % Virtual VCU transmitted pedal CAN payload.
hil_obs_virtual_vcu_state_id = Simulink.Signal(StorageClass="ExportedGlobal")  % Virtual VCU state identifier.
hil_obs_virtual_vcu_main_enable = Simulink.Signal(StorageClass="ExportedGlobal")  % Virtual VCU main-enable output.
hil_obs_virtual_vcu_precharge_enable = Simulink.Signal(StorageClass="ExportedGlobal")  % Virtual VCU precharge-enable output.
hil_obs_virtual_vcu_inverter_control_enable = Simulink.Signal(StorageClass="ExportedGlobal")  % Virtual VCU inverter-control-enable output.
hil_obs_virtual_vcu_pedal_tx_count = Simulink.Signal(StorageClass="ExportedGlobal")  % Virtual VCU pedal transmit counter.
hil_obs_virtual_vcu_control_frame_1 = Simulink.Signal(StorageClass="ExportedGlobal")  % Virtual VCU control-frame 1 CAN payload.
hil_obs_virtual_vcu_apps_brake_fault = Simulink.Signal(StorageClass="ExportedGlobal")  % Virtual VCU APPS/brake plausibility-fault indicator.
hil_obs_virtual_vcu_torque_request_nm = Simulink.Signal(StorageClass="ExportedGlobal")  % Virtual VCU decoded torque request in Nm.
hil_cmd_pedals_plausibility_override = Simulink.Parameter(false, StorageClass="SimulinkGlobal", DataType="boolean", Min=0, Max=1)
hil_cmd_digital_main_button = Simulink.Parameter(false, StorageClass="SimulinkGlobal", DataType="boolean", Min=0, Max=1)
hil_cmd_digital_cooling_switch = Simulink.Parameter(false, StorageClass="SimulinkGlobal", DataType="boolean", Min=0, Max=1)
hil_cmd_digital_shutdown_feedback = Simulink.Parameter(false, StorageClass="SimulinkGlobal", DataType="boolean", Min=0, Max=1)
hil_cmd_digital_precharge_sequence = Simulink.Parameter(uint32(0), StorageClass="SimulinkGlobal", Min=0, Max=4294967295)
hil_cmd_digital_main_button_sequence = Simulink.Parameter(uint32(0), StorageClass="SimulinkGlobal", Min=0, Max=4294967295)
hil_cmd_dc_link12_v = Simulink.Parameter(0, StorageClass="SimulinkGlobal", Min=0, Max=1023.984375)
hil_cmd_dc_link34_v = Simulink.Parameter(0, StorageClass="SimulinkGlobal", Min=0, Max=1023.984375)
hil_cmd_inverter1_load_nm = Simulink.Parameter(0, StorageClass="SimulinkGlobal", Min=-200, Max=200)
hil_cmd_inverter1_connected = Simulink.Parameter(true, StorageClass="SimulinkGlobal", DataType="boolean", Min=0, Max=1)
hil_cmd_inverter1_fault_mask = Simulink.Parameter(uint32(0), StorageClass="SimulinkGlobal", Min=0, Max=4294967295)
hil_cmd_inverter2_load_nm = Simulink.Parameter(0, StorageClass="SimulinkGlobal", Min=-200, Max=200)
hil_cmd_inverter2_connected = Simulink.Parameter(true, StorageClass="SimulinkGlobal", DataType="boolean", Min=0, Max=1)
hil_cmd_inverter2_fault_mask = Simulink.Parameter(uint32(0), StorageClass="SimulinkGlobal", Min=0, Max=4294967295)
hil_cmd_inverter3_load_nm = Simulink.Parameter(0, StorageClass="SimulinkGlobal", Min=-200, Max=200)
hil_cmd_inverter3_connected = Simulink.Parameter(true, StorageClass="SimulinkGlobal", DataType="boolean", Min=0, Max=1)
hil_cmd_inverter3_fault_mask = Simulink.Parameter(uint32(0), StorageClass="SimulinkGlobal", Min=0, Max=4294967295)
hil_cmd_inverter4_load_nm = Simulink.Parameter(0, StorageClass="SimulinkGlobal", Min=-200, Max=200)
hil_cmd_inverter4_connected = Simulink.Parameter(true, StorageClass="SimulinkGlobal", DataType="boolean", Min=0, Max=1)
hil_cmd_inverter4_fault_mask = Simulink.Parameter(uint32(0), StorageClass="SimulinkGlobal", Min=0, Max=4294967295)
hil_cmd_can_drop_control_mask = Simulink.Parameter(uint8(0), StorageClass="SimulinkGlobal", Min=0, Max=255)
hil_cmd_can_drop_status_mask = Simulink.Parameter(uint16(0), StorageClass="SimulinkGlobal", Min=0, Max=65535)
hil_cmd_gui_heartbeat = Simulink.Parameter(uint32(0), StorageClass="SimulinkGlobal", Min=0, Max=4294967295)
hil_safe_analog_reset_v = Simulink.Parameter([0 0 0 0], StorageClass="SimulinkGlobal", Min=0, Max=0)
hil_safe_digital_reset = Simulink.Parameter(repmat(false, 1, 8), StorageClass="SimulinkGlobal", DataType="boolean", Min=0, Max=0)
hil_control_can_ids = uint32([390; 406; 422; 438])
hil_status_can_ids = uint32([899; 901; 915; 917; 931; 933; 947; 949; 1024])
hil_torque_profile_id = "ephorus3-v1.03-candidate-1over256"
hil_torque_scale_nm_per_count = 0.00390625
hil_torque_scale_verified = true
hil_torque_results_provisional = true

CAN_MESSAGE_BUS = Simulink.Bus()
  Extended: uint8
  Length: uint8
  Remote: uint8
  Error: uint8
  ID: uint32
  Timestamp: double
  Data: uint8[8]

hil_cal_pedals_released_v1 = Simulink.Parameter(1.515679, StorageClass="SimulinkGlobal", Min=0, Max=5)
hil_cal_pedals_pressed_v1 = Simulink.Parameter(1.163195, StorageClass="SimulinkGlobal", Min=0, Max=5)
hil_cal_pedals_released_v2 = Simulink.Parameter(3.202564, StorageClass="SimulinkGlobal", Min=0, Max=5)
hil_cal_pedals_pressed_v2 = Simulink.Parameter(2.341497, StorageClass="SimulinkGlobal", Min=0, Max=5)
hil_cal_pedals_released_v3 = Simulink.Parameter(0.4544518, StorageClass="SimulinkGlobal", Min=0, Max=5)
hil_cal_pedals_pressed_v3 = Simulink.Parameter(1.601282, StorageClass="SimulinkGlobal", Min=0, Max=5)
hil_cal_pedals_released_v4 = Simulink.Parameter(0.4544518, StorageClass="SimulinkGlobal", Min=0, Max=5)
hil_cal_pedals_pressed_v4 = Simulink.Parameter(1.601282, StorageClass="SimulinkGlobal", Min=0, Max=5)
hil_hardware_preflight_complete = true