% Requirement links of BMS_MIL_Test.mldatx (R2025b)

item 1 verifies Requirements.slreqx#1: Min Voltage and Max Voltage of battery pack (24V to 48V)
item 1 verifies Requirements.slreqx#2: Fault management system
item 1 verifies Requirements.slreqx#11
item 1 verifies Requirements.slreqx#14
item 1 verifies Requirements.slreqx#15
item 2 verifies Requirements.slreqx#17
item 3 verifies Requirements.slreqx#4: Controller's update frequnecy
item 4 verifies Requirements.slreqx#7: SOC estimation using EKF/UKF