% Simulink data dictionary io614_can_visibility_test_R2024b.sldd

tx_id = Simulink.Parameter(uint32(899), StorageClass="SimulinkGlobal", Min=0, Max=2047)
tx_dlc = Simulink.Parameter(uint8(8), StorageClass="SimulinkGlobal", Min=0, Max=8)
tx_payload_u8 = Simulink.Parameter(uint8([1 2 3 4 5 6 7 8]), StorageClass="SimulinkGlobal", Min=0, Max=255)
tx_period_ms = Simulink.Parameter(100, StorageClass="SimulinkGlobal", Min=1, Max=60000)
io614_can_visibility_vcu_control_ids = uint32([390; 406; 422; 438])
io614_can_visibility_vcu_status_ids = uint32([899; 901; 915; 917; 931; 933; 947; 949; 1024])

CAN_MESSAGE_BUS = Simulink.Bus()
  Extended: uint8
  Length: uint8
  Remote: uint8
  Error: uint8
  ID: uint32
  Timestamp: double
  Data: uint8[8]

tx_enable = Simulink.Parameter(1, StorageClass="SimulinkGlobal", DataType="boolean", Min=0, Max=1)